# Grasshopper definition gear example.gh (Grasshopper 1.0.7)
# plug-ins: Gear

number_slider = Slider(20, range=0..100)
number_slider_2 = Slider(12, range=0..100)
number_slider_3 = Slider(16, range=0..100)
pflip = FlipPlane(Plane=PlaneXY(382.821807, 7.740674171, 0), ReverseX=Toggle(True), ReverseY=False, SwapAxes=True)
neg = Negative(Value=number_slider)
addition = Addition(A="150", B=number_slider)
cir = Circle(Plane=pflip, Radius=Slider(12, range=5..20))
addition_2 = Addition(A="200", B=number_slider_3, C=number_slider_2)
number_slider_4 = Slider(34, range=0..50)
pt = ConstructPoint(XCoordinate=addition, YCoordinate=neg, ZCoordinate=0)
pt_2 = ConstructPoint(XCoordinate="150", YCoordinate=0, ZCoordinate=0)
Y = UnitY(Factor=1)
pt_3 = Point([Point(22.83237292, -0.3415213766, 3.592403123), Point(14.14458833, -0.3415213766, 23), Point(7.109929127, 24.00388835, 23)])
pt_4 = Point(Point(82.65275619, 2.36368516, 0))
ratchet = RatchetPawl(Circle=cir, Teeth=12, TeethDeth=2, PawlNumber=3, PawlRadius=0.2, PawlThickness=1)  # -> Ratchet, Pawl, PawlCover
pt_5 = ConstructPoint(XCoordinate=addition_2, YCoordinate=0, ZCoordinate=0)
pline = PolyLine(Vertices=pt_3, Closed=False)
crv = Curve([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])
cir_2 = Circle(Plane=pt_4, Radius=Slider(19, range=0..100))
line = LineSDL(Start=pt, Direction=Y, Length=Slider(43, range=0..100))
Z = UnitZ(Factor=1)
cir_3 = Circle(Plane=["200,0,0", pt_5], Radius=[number_slider_3, number_slider_2])
Z_2 = UnitZ(Factor="-1")
spurg = SpurGear(Circles=crv, Teeth=Slider(12, range=0..100), Angle=22.5, Shift=0.1, Addendum=1, Dedendum=1.25)  # -> Gears, Pitch, Ratio
axepitch = Axe2Pitch(Axe=pline, Radius=Slider(15.2, range=0..100))  # -> PitchCircle, AxePolyline
anglepitch = Angle2Pitch(Circle=cir_2, Radius=Slider(23, range=0..100), Angle=Slider(0, range=-90..90), Location=Slider(0, range=0..360))  # -> PitchCircle, AxePolyline
number_slider_5 = Slider(54, range=0..70)

expression = Expression(r=number_slider, t=number_slider_4, Expression="2*r/t")
cir_4 = Circle(Plane=pt_2, Radius=number_slider)

number_slider_6 = Slider(13, range=0..100)
extr = Extrude(Base=ratchet.PawlCover, Direction=Z_2)
extr_2 = Extrude(Base=ratchet.Pawl, Direction=Z)
extr_3 = Extrude(Base=ratchet.Ratchet, Direction=Z)
spurg_2 = SpurGear(Circles=cir_3, Teeth=Slider(26, range=0..50), Angle=22.5, Shift=0.1, Addendum=1, Dedendum=1.25)  # -> Gears, Pitch, Ratio
panel = Panel(spurg.Gears)
panel_2 = Panel(spurg.Ratio)
panel_3 = Panel(spurg.Pitch)
cap = CapHoles(Brep=extr_2)
helicalg = HelicalGear(Gear=spurg_2.Gears, Pitch=spurg_2.Pitch, Angle=Slider(42, range=0..70), Heigh=Slider(13, range=0..100), Solid=False)
rack = Rack(Line=line, CircleModule=cir_4, Teeth=number_slider_4, Angle=22.5, Addendum=1, Dedendum=1.25)
spurg_3 = SpurGear(Circles=cir_4, Teeth=number_slider_4, Angle=22.5, Shift=0.1, Addendum=1, Dedendum=1.25)  # -> Gears, Pitch, Ratio
bevelg = BevelGear(
    Circle=axepitch.PitchCircle,
    Polyline=axepitch.AxePolyline,
    Teeth=Slider(19, range=0..100),
    Depth=Slider(5, range=0..100),
    HoleSize=[Slider(2, range=0..10), Slider(2, range=0..10)],
    Angle=22.5,
    Shift=0.1,
    Addendum=0.95,
    Dedendum=1.25,
    Option=Toggle(False))  # -> Gears, Pitch, Ratio
bevelg_2 = BevelGear(
    Circle=anglepitch.PitchCircle,
    Polyline=anglepitch.AxePolyline,
    Teeth=Slider(25, range=0..100),
    Depth=Slider(13, range=0..100),
    HoleSize=[Slider(2, range=0..10), Slider(2, range=0..10)],
    Angle=22.5,
    Shift=0.1,
    Addendum=0.95,
    Dedendum=1.25,
    Option=Toggle(False))  # -> Gears, Pitch, Ratio
helicalr = HelicalRack(
    Line=line,
    CircleModule=cir_4,
    Teeth=number_slider_4,
    Angle=22.5,
    HelicalAngle=number_slider_5,
    Depth=number_slider_6,
    Addendum=1,
    Dedendum=1.25)
helicalg_2 = HelicalGear(Gear=spurg_3.Gears, Pitch=spurg_3.Pitch, Angle=number_slider_5, Heigh=number_slider_6, Solid=False)
